# Grasshopper definition EarthToRhino_SetEarthAnchor_Example.gh (Grasshopper 1.0.8)
# plug-ins: EarthToRhino

# ----
# YOU CAN FIND LAT LON DATA FROM GOOGLE EARTH AND PASTE IT IN HERE.
earth_anchor = Panel("-73.636521")
earth_anchor_2 = Panel("40.731970")

point = Point("500,500")
number = Number(earth_anchor)
set_anchor_point = SetAnchorPoint(Set=Toggle(False), ModelBasePoint=point, Latitude=earth_anchor_2, Longitude=number)  # -> AnchorPoint, EarthAnchorPoint
